# Grasshopper definition cnc-box.gh (Grasshopper 0.9.80)

width = Slider(40, range=0..100)
height = Slider(40, range=0..70)
width_2 = Slider(60, range=0..100)
height_2 = Slider(40, range=0..70)
vector_xyz = VectorXYZ(XComponent=0, YComponent=height_2, ZComponent=0)  # -> Vector, Length
side_short = Rectangle(Plane=PlaneXY(0, 0, 0), XSize=width, YSize=height, Radius=0)  # -> Rectangle, Length
side_long = Rectangle(Plane=PlaneXY(0, 0, 0), XSize=width_2, YSize=height_2, Radius=0)  # -> Rectangle, Length
move = Move(Geometry=side_short.Rectangle, Motion=vector_xyz.Vector)  # -> Geometry, Transform

slot_width = Slider(1.5, range=0..70)
slot_length = Slider(6, range=0..100)
x = Slider(3, range=0..50)
y = Slider(3, range=0..50)
slots = Rectangle(Plane=PlaneXY(0, 0, 0), XSize=slot_width, YSize=slot_length, Radius=0)  # -> Rectangle, Length
vector_xyz_2 = VectorXYZ(XComponent=x, YComponent=y, ZComponent=0)  # -> Vector, Length
move_2 = Move(Geometry=slots.Rectangle, Motion=vector_xyz_2.Vector)  # -> Geometry, Transform
number = Slider(2, range=0..10)

x_2 = Slider(3, range=0..50)
slot_width_2 = Slider(6, range=0..70)
addition = Addition(A=height_2, B=x_2)
slots_2 = Rectangle(Plane=PlaneXY(0, 0, 0), XSize=slot_width_2, YSize=slot_length, Radius=0)  # -> Rectangle, Length
negative = Negative(Value=slot_width_2)
vector_xyz_3 = VectorXYZ(XComponent=negative, YComponent=addition, ZComponent=0)  # -> Vector, Length
addition_2 = Addition(A=width, B=slot_width_2)
number_2 = Number(2)
vector_xyz_4 = VectorXYZ(XComponent=addition_2, YComponent=0, ZComponent=0)  # -> Vector, Length
move_3 = Move(Geometry=slots_2.Rectangle, Motion=vector_xyz_3.Vector)  # -> Geometry, Transform
multiplication = Multiplication(A=slot_width_2, B=number_2)
subtraction = Subtraction(A=height, B=multiplication)
vector_xyz_5 = VectorXYZ(XComponent=0, YComponent=subtraction, ZComponent=0)  # -> Vector, Length
linear_array = LinearArray(Geometry=move_3.Geometry, Direction=vector_xyz_4.Vector, Count=number)  # -> Geometry, Transform
linear_array_2 = LinearArray(Geometry=linear_array.Geometry, Direction=vector_xyz_5.Vector, Count=number)  # -> Geometry, Transform

number_3 = Number(3)
multiplication_2 = Multiplication(A=x, B=number_3)
number_4 = Number(4)
subtraction_2 = Subtraction(A=width_2, B=multiplication_2)
multiplication_3 = Multiplication(A=y, B=number_4)
vector_xyz_6 = VectorXYZ(XComponent=subtraction_2, YComponent=0, ZComponent=0)  # -> Vector, Length
subtraction_3 = Subtraction(A=height_2, B=multiplication_3)
vector_xyz_7 = VectorXYZ(XComponent=0, YComponent=subtraction_3, ZComponent=0)  # -> Vector, Length
linear_array_3 = LinearArray(Geometry=move_2.Geometry, Direction=vector_xyz_6.Vector, Count=number)  # -> Geometry, Transform
linear_array_4 = LinearArray(Geometry=linear_array_3.Geometry, Direction=vector_xyz_7.Vector, Count=number)  # -> Geometry, Transform

trim_with_regions = TrimWithRegions(Curve=[linear_array_2.Geometry, move.Geometry], Regions=move.Geometry)  # -> Inside, Outside
