# Grasshopper definition light-grid.gh (Grasshopper 0.9.80)

width = Slider(608, range=0..1000)
height = Slider(304, range=0..1000)
light_diameter = Slider(10.995, range=0..20)
x = Slider(40, range=0..100)
y = Slider(40, range=0..100)
radius = Slider(15, range=0..20)
rectangle = Rectangle(Plane=PlaneXY(0, 0, 0), XSize=width, YSize=height, Radius=0)  # -> Rectangle, Length
circle = Circle(Plane=PlaneXY(0, 0, 0), Radius=light_diameter)
vector_xyz = VectorXYZ(XComponent=x, YComponent=y, ZComponent=0)  # -> Vector, Length
x_2 = Slider(66, range=0..100)
y_2 = Slider(55, range=0..100)
move = Move(Geometry=circle, Motion=vector_xyz.Vector)  # -> Geometry, Transform
x_3 = Slider(9, range=0..100)
y_3 = Slider(5, range=0..100)
rectangle_2 = Rectangle(Plane=PlaneXY(0, 0, 0), XSize=x_2, YSize=y_2, Radius=0)  # -> Rectangle, Length

fillet = Fillet(Curve=rectangle.Rectangle, Radius=radius)
rectangular_array = RectangularArray(Geometry=move.Geometry, Cell=rectangle_2.Rectangle, XCount=x_3, YCount=y_3)  # -> Geometry, Transform
