# Grasshopper definition cutout-triangles-kit.gh (Grasshopper 0.9.80)

# ----
# 1st Material Thickness Input
notch_width_enter_material_thickness_her = Slider(0.125, range=0..20)  # "Notch width (ENTER MATERIAL THICKNESS HERE)"

# ----
# 2nd Material Thickness Input
notch_width_enter_material_thickness_her_2 = Slider(0.114, range=0..20)  # "Notch width (ENTER MATERIAL THICKNESS HERE)"

# ----
# Connector Material Thickness Input
notch_width_enter_material_thickness_her_3 = Slider(0.06, range=0..20)  # "Notch width (ENTER MATERIAL THICKNESS HERE)"

# ----
# Set triangle sizes
triangles_wide = Slider(8, range=0..40)
triangles_tall = Slider(5, range=0..28)
# Open Polygon Triangle Press Fit Kit
# Klare Frank
# April 24, 2019
triangle_size = Slider(2.375, range=0..20)
triangular = Triangular(Plane=PlaneXY(0, 0, 0), Size=triangle_size, ExtentX=triangles_wide, ExtentY=triangles_tall)  # -> Cells, Points

notch_depth_x_2 = Slider(0.2, range=0..20)

# ----
# Find the center of each triangle
brep_edges = BrepEdges(Brep=triangular.Cells)  # -> Naked, Interior, NonManifold
boolean = Boolean([True, False, False])
boolean_2 = Boolean([False, True, False])
boolean_3 = Boolean([False, False, True])
cull_pattern = CullPattern(List=brep_edges.Naked, CullPattern=boolean)
cull_pattern_2 = CullPattern(List=brep_edges.Naked, CullPattern=boolean_2)
cull_pattern_3 = CullPattern(List=brep_edges.Naked, CullPattern=boolean_3)
end_points = EndPoints(Curve=cull_pattern)  # -> Start, End
end_points_2 = EndPoints(Curve=cull_pattern_2)  # -> Start, End
end_points_3 = EndPoints(Curve=cull_pattern_3)  # -> Start, End
incentre = Incentre(PointA=end_points.Start, PointB=end_points_2.Start, PointC=end_points_3.Start)  # -> Incentre, BisectorA, BisectorB, BisectorC

# ----
# Make the connector 4x as wide as the notch
# Create the connector
connector_height = Slider(0.25, range=0..20)
_4 = Number(4)
multiplication = Multiplication(A=notch_depth_x_2, B=_4)
rectangle = Rectangle(Plane=PlaneXY(0, 0, 0), XSize=multiplication, YSize=connector_height, Radius=0)  # -> Rectangle, Length

# ----
# Construct rectangle from center
# https://www.grasshopper3d.com/forum/topics/make-a-rectangle-around-a-centre
construct_domain = ConstructDomain(
    DomainStart=expr("x * 0.5", notch_width_enter_material_thickness_her_3),
    DomainEnd=expr("-x * 0.5", notch_width_enter_material_thickness_her_3))
construct_domain_2 = ConstructDomain(DomainStart=expr("-x * 1", notch_depth_x_2), DomainEnd=expr("x * 0", notch_depth_x_2))

# ----
# Do it in reverse for the opposite triangles
construct_domain_3 = ConstructDomain(
    DomainStart=expr("x * 0.5", notch_width_enter_material_thickness_her_3),
    DomainEnd=expr("-x * 0.5", notch_width_enter_material_thickness_her_3))
construct_domain_4 = ConstructDomain(DomainStart=expr("-x * 0", notch_depth_x_2), DomainEnd=expr("x * 1", notch_depth_x_2))

# ----
# Move the notches
construct_domain_5 = ConstructDomain(DomainStart=expr("x * -1", notch_depth_x_2), DomainEnd=expr("-x * 2", notch_depth_x_2))
construct_domain_6 = ConstructDomain(
    DomainStart=expr("x * .5", notch_width_enter_material_thickness_her),
    DomainEnd=expr("-x * 0.5", notch_width_enter_material_thickness_her))
construct_domain_7 = ConstructDomain(DomainStart=expr("x * 2", notch_depth_x_2), DomainEnd=expr("-x * -1", notch_depth_x_2))
construct_domain_8 = ConstructDomain(
    DomainStart=expr("x * .5", notch_width_enter_material_thickness_her_2),
    DomainEnd=expr("-x * 0.5", notch_width_enter_material_thickness_her_2))

# ----
# Make the connector
polygon_center = PolygonCenter(Polyline=rectangle.Rectangle)  # -> CenterV, CenterE, CenterA
rectangle_2 = Rectangle(Plane=polygon_center.CenterV, XSize=construct_domain_5, YSize=construct_domain_6, Radius=0)  # -> Rectangle, Length
rectangle_3 = Rectangle(Plane=polygon_center.CenterV, XSize=construct_domain_7, YSize=construct_domain_8, Radius=0)  # -> Rectangle, Length
region_difference = RegionDifference(CurvesA=rectangle.Rectangle, CurvesB=[rectangle_2.Rectangle, rectangle_3.Rectangle])

# ----
# Make the connector 2x as wide as the notch
# Create the angled connectors
# Make the angled sides
connector_height_2 = Slider(0.25, range=0..20)
_2 = Number(2)
multiplication_2 = Multiplication(A=notch_depth_x_2, B=_2)
rectangle_4 = Rectangle(Plane=PlaneXY(0, 0, 0), XSize=multiplication_2, YSize=connector_height_2, Radius=0)  # -> Rectangle, Length
box_corners = BoxCorners(Box=rectangle_4.Rectangle)  # -> CornerA, CornerB, CornerC, CornerD, CornerE, CornerF, CornerG, CornerH
rotatation = Slider(45, range=0..360)
rotatation_2 = Slider(30, range=0..360)
rotatation_3 = Slider(15, range=0..360)
radians = Radians(Degrees=rotatation)
radians_2 = Radians(Degrees=rotatation_2)
radians_3 = Radians(Degrees=rotatation_3)
region_difference_2 = RegionDifference(CurvesA=rectangle_4.Rectangle, CurvesB=rectangle_2.Rectangle)
region_difference_3 = RegionDifference(CurvesA=rectangle_4.Rectangle, CurvesB=rectangle_2.Rectangle)
region_difference_4 = RegionDifference(CurvesA=rectangle_4.Rectangle, CurvesB=rectangle_2.Rectangle)
rotate = Rotate(Geometry=region_difference_2, Angle=radians, Plane=box_corners.CornerB)  # -> Geometry, Transform
rotate_2 = Rotate(Geometry=region_difference_3, Angle=radians_2, Plane=box_corners.CornerB)  # -> Geometry, Transform
rotate_3 = Rotate(Geometry=region_difference_4, Angle=radians_3, Plane=box_corners.CornerB)  # -> Geometry, Transform

# ----
# Make the non-angled side
unit_x = UnitX(Factor=multiplication_2)
move = Move(Geometry=rectangle_4.Rectangle, Motion=unit_x)  # -> Geometry, Transform
region_difference_5 = RegionDifference(CurvesA=move.Geometry, CurvesB=rectangle_3.Rectangle)

# ----
# Make inner triangles
scale = Scale(Geometry=graft(triangular.Cells), Center=incentre.Incentre, Factor=0.5)  # -> Geometry, Transform

# ----
# Make Notches
end_points_4 = EndPoints(Curve=incentre.BisectorA)  # -> flatten(Start), flatten(End)
boolean_4 = Boolean([False, True])
cull_pattern_4 = CullPattern(List=end_points_4.End, CullPattern=boolean_4)
boolean_5 = Boolean([False, True])
xy_plane = XYPlane(Origin=cull_pattern_4)
cull_pattern_5 = CullPattern(List=flatten(incentre.Incentre), CullPattern=boolean_5)
rectangle_5 = Rectangle(Plane=xy_plane, XSize=construct_domain, YSize=construct_domain_2, Radius=0)  # -> Rectangle, Length
xy_plane_2 = XYPlane(Origin=cull_pattern_5)
number = Number(3)
polar_array = PolarArray(Geometry=rectangle_5.Rectangle, Plane=xy_plane_2, Count=number, Angle=6.283185307)  # -> Geometry, Transform

# ----
# Make Notches
end_points_5 = EndPoints(Curve=incentre.BisectorB)  # -> flatten(Start), flatten(End)
boolean_6 = Boolean([True, False])
cull_pattern_6 = CullPattern(List=end_points_5.End, CullPattern=boolean_6)
# This is so the 0° notches get created first so
# we don’t have to do weird things with rotating.
boolean_7 = Boolean([True, False])
xy_plane_3 = XYPlane(Origin=cull_pattern_6)
cull_pattern_7 = CullPattern(List=flatten(incentre.Incentre), CullPattern=boolean_7)
rectangle_6 = Rectangle(Plane=xy_plane_3, XSize=construct_domain_3, YSize=construct_domain_4, Radius=0)  # -> Rectangle, Length
xy_plane_4 = XYPlane(Origin=cull_pattern_7)
number_2 = Number(3)
polar_array_2 = PolarArray(Geometry=rectangle_6.Rectangle, Plane=xy_plane_4, Count=number_2, Angle=6.283185307)  # -> Geometry, Transform

box_corners_2 = BoxCorners(Box=region_difference_5)  # -> CornerA, CornerB, CornerC, CornerD, CornerE, CornerF, CornerG, CornerH

brep_edges_2 = BrepEdges(Brep=rotate_3.Geometry)  # -> Naked, Interior, NonManifold
brep_edges_3 = BrepEdges(Brep=rotate_2.Geometry)  # -> Naked, Interior, NonManifold
brep_edges_4 = BrepEdges(Brep=rotate.Geometry)  # -> Naked, Interior, NonManifold
brep_edges_5 = BrepEdges(Brep=region_difference_5)  # -> Naked, Interior, NonManifold
boolean_8 = Boolean([True, True, True, True, True, True, True, False])
boolean_9 = Boolean([True, True, True, True, True, True, True, False])
boolean_10 = Boolean([True, True, True, True, True, True, True, False])
number_3 = Number(7)
number_4 = Number(7)
number_5 = Number(7)
boolean_11 = Boolean([True, False, True, True, True, True, True, True])
list_item = ListItem(List=brep_edges_2.Naked, Index=number_3, Wrap=True)
cull_pattern_8 = CullPattern(List=brep_edges_4.Naked, CullPattern=boolean_8)
cull_pattern_9 = CullPattern(List=brep_edges_2.Naked, CullPattern=boolean_9)
list_item_2 = ListItem(List=brep_edges_3.Naked, Index=number_4, Wrap=True)
cull_pattern_10 = CullPattern(List=brep_edges_3.Naked, CullPattern=boolean_10)
list_item_3 = ListItem(List=brep_edges_4.Naked, Index=number_5, Wrap=True)
cull_pattern_11 = CullPattern(List=brep_edges_5.Naked, CullPattern=boolean_11)  # -> flatten(List)
end_points_6 = EndPoints(Curve=list_item)  # -> Start, End
end_points_7 = EndPoints(Curve=list_item_2)  # -> Start, End
# Join curves to create full angled connectors
end_points_8 = EndPoints(Curve=list_item_3)  # -> Start, End
line = Line(StartPoint=box_corners_2.CornerD, EndPoint=end_points_6.End)
line_2 = Line(StartPoint=box_corners_2.CornerD, EndPoint=end_points_7.End)
line_3 = Line(StartPoint=box_corners_2.CornerD, EndPoint=end_points_8.End)
join_curves = JoinCurves(Curves=flatten([line_3, cull_pattern_8, cull_pattern_11]), Preserve=False)  # -> flatten(Curves)
join_curves_2 = JoinCurves(Curves=flatten([line_2, cull_pattern_10, cull_pattern_11]), Preserve=False)  # -> flatten(Curves)
join_curves_3 = JoinCurves(Curves=flatten([cull_pattern_9, line, cull_pattern_11]), Preserve=False)  # -> flatten(Curves)

# ----
# Bake All Connector Types
bake_connectors = Group(Objects=graft([region_difference, join_curves_3, join_curves_2, join_curves]))

# ----
# Bake All Triangles
to_bake = Group(Objects=[polar_array.Geometry, polar_array_2.Geometry, scale.Geometry, triangular.Cells])
