# Grasshopper definition intersected-triangles-2.gh (Grasshopper 0.9.80)

# ----
# Build the Triangular Grid
number_slider = Slider(2.3, range=0..10)
number_slider_2 = Slider(6, range=0..10)
triangle_grid = Triangular(Plane=PlaneXY(0, 0, 0), Size=number_slider, ExtentX=Slider(9, range=0..10), ExtentY=number_slider_2)  # -> Cells, Points

# ----
# Separate each triangle side in grid
brep_edges = BrepEdges(Brep=triangle_grid.Cells)  # -> Naked, Interior, NonManifold

# ----
# Make inner triangles
_3_sides_to_a_triangle = Number(3)
join_curves = JoinCurves(Curves=brep_edges.Naked, Preserve=False)
divide_curve = DivideCurve(Curve=triangle_grid.Cells, Count=_3_sides_to_a_triangle, Kinks=False)  # -> flatten(Points), Tangents, Parameters
boolean = Boolean([True, False, False])
boolean_2 = Boolean([False, True, False])
boolean_3 = Boolean([False, False, True])
nth_1 = CullPattern(List=divide_curve.Points, CullPattern=boolean)
nth_2 = CullPattern(List=divide_curve.Points, CullPattern=boolean_2)
nth_3 = CullPattern(List=divide_curve.Points, CullPattern=boolean_3)
triangle_math = Incentre(PointA=nth_1, PointB=nth_2, PointC=nth_3)  # -> Incentre, BisectorA, graft(BisectorB), BisectorC
scale = Scale(Geometry=join_curves, Center=graft(triangle_math.Incentre), Factor=0.5)  # -> Geometry, Transform

# ----
# Add connector notches
end_points = EndPoints(Curve=graft(triangle_math.BisectorA))  # -> flatten(Start), flatten(End)
end_points_2 = EndPoints(Curve=graft(triangle_math.BisectorC))  # -> flatten(Start), flatten(End)
boolean_4 = Boolean([False, True, False, True, False, True, True, False, True, False, True, False])
boolean_5 = Boolean([True, False, True, False, True, False, False, True, False, True, False, True])
notch_size = Slider(0.25, range=0..1)
thickness = Slider(0.19, range=0..1)
cull_pattern = CullPattern(List=end_points.End, CullPattern=boolean_4)
cull_pattern_2 = CullPattern(List=end_points_2.End, CullPattern=boolean_5)
xy_plane = XYPlane(Origin=cull_pattern_2)
xy_plane_2 = XYPlane(Origin=cull_pattern)
rectangle = Rectangle(Plane=xy_plane_2, XSize=thickness, YSize=notch_size, Radius=0)  # -> simplify(flatten(Rectangle)), Length
rectangle_2 = Rectangle(Plane=xy_plane, XSize=thickness, YSize=notch_size, Radius=0)  # -> Rectangle, Length
number = Number(2)
division = Division(A=thickness, B=number)
negative = Negative(Value=notch_size)
negative_2 = Negative(Value=division)
vector_xyz = VectorXYZ(XComponent=negative_2, YComponent=negative, ZComponent=0)  # -> Vector, Length
vector_xyz_2 = VectorXYZ(XComponent=negative_2, YComponent=0, ZComponent=0)  # -> Vector, Length
move = Move(Geometry=rectangle.Rectangle, Motion=vector_xyz.Vector)  # -> Geometry, Transform
move_2 = Move(Geometry=rectangle_2.Rectangle, Motion=vector_xyz_2.Vector)  # -> Geometry, Transform

material_size = Rectangle(Plane=PlaneXY(0, 0, 0), XSize=Slider(12, range=0..20), YSize=Slider(12, range=0..20), Radius=0)  # -> Rectangle, Length

# ----
# Triangle Math
end_points_3 = EndPoints(Curve=triangle_math.BisectorA)  # -> Start, End
end_points_4 = EndPoints(Curve=triangle_math.BisectorB)  # -> Start, flatten(End)
length = Length(Curve=triangle_math.BisectorC)
number_2 = Number(2)
number_3 = Number(2)
division_2 = Division(A=number_slider, B=number_2)
division_3 = Division(A=length, B=number_3)
number_4 = Number(0)
list_item = ListItem(List=end_points_4.End, Index=number_4, Wrap=True)
list_item_2 = ListItem(List=end_points_4.End, Index=number_slider_2, Wrap=True)
deconstruct = Deconstruct(Point=list_item_2)  # -> XComponent, YComponent, ZComponent
deconstruct_2 = Deconstruct(Point=list_item)  # -> XComponent, YComponent, ZComponent
subtraction = Subtraction(A=deconstruct.XComponent, B=deconstruct_2.XComponent)
number_5 = Number(2)
division_4 = Division(A=subtraction, B=number_5)
negative_3 = Negative(Value=division_4)
vector_xyz_3 = VectorXYZ(XComponent=negative_3, YComponent=division_3, ZComponent=0)  # -> Vector, Length

trim_with_region = TrimWithRegion(Curve=[scale.Geometry, triangle_grid.Cells], Region=material_size.Rectangle)  # -> Inside, Outside
number_6 = Number(2.094395102)
number_7 = Number(4.188790205)
number_8 = Number(4.188790205)
number_9 = Number(2.094395102)
rotate = Rotate(Geometry=move.Geometry, Angle=number_6, Plane=xy_plane_2)  # -> Geometry, Transform
rotate_2 = Rotate(Geometry=move.Geometry, Angle=number_7, Plane=xy_plane_2)  # -> Geometry, Transform
rotate_3 = Rotate(Geometry=move_2.Geometry, Angle=number_8, Plane=xy_plane)  # -> Geometry, Transform
rotate_4 = Rotate(Geometry=move_2.Geometry, Angle=number_9, Plane=xy_plane)  # -> Geometry, Transform

vector_xyz_4 = VectorXYZ(XComponent=division_4, YComponent=division_3, ZComponent=0)  # -> Vector, Length
move_3 = Move(Geometry=[rotate_2.Geometry, rotate_3.Geometry], Motion=vector_xyz_3.Vector)  # -> Geometry, Transform
move_4 = Move(Geometry=[rotate.Geometry, rotate_4.Geometry], Motion=vector_xyz_4.Vector)  # -> Geometry, Transform
custom_preview = CustomPreview(
    Geometry=[move_3.Geometry, move_4.Geometry, move.Geometry, move_2.Geometry],
    Shader={ambient=RGB(0, 0, 0), diffuse=RGB(255, 105, 180), emission=RGB(76, 32, 54), shine=0.5, specular=RGB(255, 255, 255), transparency=0})
