# Grasshopper definition intersected-triangles-final.gh (Grasshopper 0.9.80)

canvas_size = Slider(11.5, range=0..20)
canvas_size_2 = Slider(11.5, range=0..20)

n_of_triangles = Slider(3, range=0..12)
_3 = Number(3)
square_root = SquareRoot(Value=_3)
division = Division(A=canvas_size, B=n_of_triangles)
number = Number(0.5)
_2 = Number(2)
mass_multiplication = MassMultiplication(Input=[square_root, number, division])  # -> Result, PartialResults
half = Division(A=division, B=_2)
_0_0 = ConstructPoint(XCoordinate=0, YCoordinate=0, ZCoordinate=0)
width_0 = ConstructPoint(XCoordinate=division, YCoordinate=0, ZCoordinate=0)
width_height = ConstructPoint(XCoordinate=half, YCoordinate=mass_multiplication.Result, ZCoordinate=0)
polyline = PolyLine(Vertices=[width_0, _0_0, width_height], Closed=Toggle(True))

canvas = Rectangle(Plane=PlaneXY(0, 0, 0), XSize=canvas_size, YSize=canvas_size_2, Radius=0)  # -> Rectangle, Length

incentre = Incentre(PointA=_0_0, PointB=width_0, PointC=width_height)  # -> Incentre, BisectorA, BisectorB, BisectorC
scale = Scale(Geometry=polyline, Center=incentre.Incentre, Factor=Slider(0.5, range=0..1))  # -> Geometry, Transform

connector_thickness = Slider(0.16, range=0..1)
_2_2 = Number(3)
connector_thickness_2 = Slider(0.105, range=0..1)
number_2 = Number(0.5)
multiplication = Multiplication(A=connector_thickness_2, B=number_2)
negative = Negative(Value=multiplication)
rectangle = Rectangle(Plane=PlaneXY(0, 0, 0), XSize=division, YSize=mass_multiplication.Result, Radius=0)  # -> Rectangle, Length

end_points = EndPoints(Curve=incentre.BisectorC)  # -> Start, End
deconstruct = Deconstruct(Point=incentre.Incentre)  # -> XComponent, YComponent, ZComponent
xy_plane = XYPlane(Origin=end_points.End)
connector_thickness_3 = Slider(0.033, range=0..1)
_2_3 = Number(4)
division_2 = Division(A=deconstruct.YComponent, B=_2_3)
_2_4 = Number(2)
division_3 = Division(A=connector_thickness_3, B=_2_4)
rectangle_2 = Rectangle(Plane=xy_plane, XSize=connector_thickness_3, YSize=division_2, Radius=0)  # -> Rectangle, Length
negative_2 = Negative(Value=division_3)
unit_x = UnitX(Factor=negative_2)
_3_2 = Number(3)

multiplication_2 = Multiplication(A=connector_thickness_3, B=_2_2)
rectangle_3 = Rectangle(Plane=PlaneXY(0, 0, 0), XSize=deconstruct.YComponent, YSize=multiplication_2, Radius=0)  # -> Rectangle, Length

curve_curve = CurveCurve(CurveA=scale.Geometry, CurveB=[incentre.BisectorA, incentre.BisectorB, incentre.BisectorC])  # -> flatten(Points), ParamsA, ParamsB
number_3 = Number(4)
list_item = ListItem(List=curve_curve.Points, Index=number_3, Wrap=True)
rectangle_4 = Rectangle(Plane=list_item, XSize=connector_thickness_3, YSize=division_2, Radius=0)  # -> Rectangle, Length; disabled

polygon_center = PolygonCenter(Polyline=rectangle_3.Rectangle)  # -> CenterV, CenterE, CenterA
rectangle_5 = Rectangle(Plane=polygon_center.CenterE, XSize=division_2, YSize=connector_thickness_2, Radius=0)  # -> Rectangle, Length
rectangle_6 = Rectangle(Plane=polygon_center.CenterE, XSize=division_2, YSize=connector_thickness, Radius=0)  # -> Rectangle, Length
negative_3 = Negative(Value=deconstruct.YComponent)
subtraction = Subtraction(A=deconstruct.YComponent)
vector_xyz = VectorXYZ(XComponent=division_2, YComponent=negative_2, ZComponent=0)  # -> Vector, Length
vector_xyz_2 = VectorXYZ(XComponent=negative_3, YComponent=negative, ZComponent=0)  # -> Vector, Length

move = Move(Geometry=[rectangle_2.Rectangle, rectangle_4.Rectangle], Motion=unit_x)  # -> Geometry, Transform
polar_array = PolarArray(Geometry=move.Geometry, Plane=incentre.Incentre, Count=_3_2, Angle=6.283185307)  # -> flatten(Geometry), Transform

move_2 = Move(Geometry=rectangle_5.Rectangle, Motion=vector_xyz_2.Vector)  # -> Geometry, Transform
move_3 = Move(Geometry=rectangle_6.Rectangle, Motion=vector_xyz.Vector)  # -> Geometry, Transform
merge = Merge(Data1=rectangle_3.Rectangle, Data3=move_3.Geometry)

# ----
# Custom Filleting
number_slider = Slider(0.62, range=0..1)
region_difference = RegionDifference(CurvesA=polyline, CurvesB=polar_array.Geometry)
discontinuity = Discontinuity(Curve=region_difference, Level=1)  # -> Points, Parameters
boolean = Boolean([True, True, False, False, True, False, True, False, False, True, True, True, False, False, True])
cull_pattern = CullPattern(List=discontinuity.Parameters, CullPattern=boolean)
fillet = Fillet(Curve=region_difference, Parameter=cull_pattern, Radius=number_slider)  # -> Curve, Parameter; disabled

end_points_2 = EndPoints(Curve=incentre.BisectorA)  # -> Start, End
number_4 = Number(3.141592654)
rotate = Rotate(Geometry=region_difference, Angle=number_4, Plane=end_points_2.End)  # -> Geometry, Transform
rectangle_7 = Rectangle(Plane=PlaneXY(0, 0, 0), XSize=division, YSize=mass_multiplication.Result, Radius=0)  # -> Rectangle, Length
rectangular_array = RectangularArray(
    Geometry=[region_difference, rotate.Geometry],
    Cell=rectangle_7.Rectangle,
    XCount=Slider(2.5, range=0..10),
    YCount=Slider(3, range=0..10))  # -> Geometry, Transform

custom_preview = CustomPreview(
    Geometry=rotate.Geometry,
    Shader={ambient=RGB(0, 0, 0), diffuse=RGB(255, 105, 180), emission=RGB(76, 32, 54), shine=0.5, specular=RGB(255, 255, 255), transparency=0})
rotate_2 = Rotate(Geometry=scale.Geometry, Angle=number_4, Plane=end_points_2.End)  # -> Geometry, Transform
rectangular_array_2 = RectangularArray(
    Geometry=[rotate_2.Geometry, scale.Geometry],
    Cell=rectangle.Rectangle,
    XCount=Slider(2.5, range=0..10),
    YCount=Slider(3, range=0..10))  # -> Geometry, Transform
