# Grasshopper definition notches.gh (Grasshopper 0.9.80)

_330 = Number(5.759586532)
number = Number(0.5235987756)
_150 = Number(2.617993878)
_210 = Number(3.665191429)
_270 = Number(4.71238898)
rectangle = Rectangle(Plane=PlaneXY(0, 0, 0), XSize=Slider(0.06, range=0..1), YSize=Slider(2, range=0..5), Radius=0)  # -> Rectangle, Length
notchs = Rectangle(Plane=PlaneXY(0, 0, 0), XSize=Slider(0.06, range=0..1), YSize=Slider(2, range=0..5), Radius=0)  # -> Rectangle, Length
geometry = Geometry(<curve referenced from the Rhino model>)
rotate = Rotate(Geometry=rectangle.Rectangle, Angle=_150, Plane=PlaneXY(0, 0, 0))  # -> Geometry, Transform
rotate_2 = Rotate(Geometry=notchs.Rectangle, Angle=_150, Plane=PlaneXY(0, 0, 0))  # -> Geometry, Transform
number_2 = Number(3)
length = Length(Curve=geometry)
division = Division(A=length, B=number_2)
rectangle_2 = Rectangle(Plane=PlaneXY(0, 0, 0), XSize=division, YSize=division, Radius=0)  # -> Rectangle, Length
rectangular_array = RectangularArray(Geometry=rotate_2.Geometry, Cell=rectangle_2.Rectangle, XCount=Slider(4, range=0..10), YCount=Slider(4, range=0..10))  # -> Geometry, Transform
