# Grasshopper definition intersected-triangles.gh (Grasshopper 0.9.80)
# Copyright: Valid In Planet ZORG (and UTOPIA)

number = Number(4.5)
number_2 = Number(5)
number_slider = Slider(8, range=4..20)
multiplication = Multiplication(A=number_slider, B=number)
triangular = Triangular(Plane=PlaneXY(0, 0, 0), Size=number_slider, ExtentX=number_slider, ExtentY=5)  # -> Cells, Points

triangle_sides = Number(3)
triangle_points = ValueList({"Point 1": 0, "Point 2": 1, "Point 3": 3}, selected="Point 1")
triangle_points_2 = ValueList({"Point 1": 0, "Point 2": 1, "Point 3": 3}, selected="Point 2")
triangle_points_3 = ValueList({"Point 1": 0, "Point 2": 1, "Point 3": 3}, selected="Point 3")
divide_curve = DivideCurve(Curve=triangular.Cells, Count=triangle_sides, Kinks=False)  # -> Points, Tangents, Parameters
flatten_tree = FlattenTree(Tree=divide_curve.Points, Path="{0}")
point_1 = ListItem(List=flatten_tree, Index=triangle_points, Wrap=True)
point_2 = ListItem(List=flatten_tree, Index=triangle_points_2, Wrap=True)
point_3 = ListItem(List=flatten_tree, Index=triangle_points_3, Wrap=True)
line = Line(StartPoint=point_1, EndPoint=point_2)
line_2 = Line(StartPoint=point_1, EndPoint=point_3)
line_3 = Line(StartPoint=point_2, EndPoint=point_3)
incentre = Incentre(PointA=point_1, PointB=point_2, PointC=point_3)  # -> Incentre, BisectorA, BisectorB, BisectorC
join_curves = JoinCurves(Curves=[line, line_2, line_3], Preserve=False)

of_intersecting_lines = Number(1)
random = Random(Range=Domain(0, 1), Number=Slider(388, range=0..800), Seed=Slider(562, range=0..800))
partition = PartitionList(List=random, Size=of_intersecting_lines)
eval = EvaluateCurve(Curve=reparameterize(simplify(graft(triangular.Cells))), Parameter=partition)  # -> Point, Tangent, Angle
ln = Line(StartPoint=graft(triangular.Points), EndPoint=eval.Point)
ext = ExtendCurve(Curve=ln, Type=0, Start=Slider(5, range=0..10), End=Slider(0.5, range=0.5..10))
trim = TrimWithRegion(Curve=simplify(ext), Region=graft(triangular.Cells))  # -> Inside, Outside
list = ValueList({"in": 0, "out": 1}, selected="in")
filter = StreamFilter(Gate=list, Stream0=trim.Inside, Stream1=trim.Outside)
lines = CustomPreview(
    Geometry=filter,
    Shader={ambient=RGB(0, 0, 0), diffuse=RGB(255, 105, 180), emission=RGB(76, 32, 54), shine=0.5, specular=RGB(255, 255, 255), transparency=0})

custom_preview = CustomPreview(
    Geometry=triangular.Cells,
    Shader={ambient=RGB(0, 0, 0), diffuse=RGB(255, 105, 180), emission=RGB(76, 32, 54), shine=0.5, specular=RGB(255, 255, 255), transparency=0})

length = Length(Curve=incentre.BisectorA)
length_2 = Length(Curve=line_3)
_2 = Number(2)
unit_x = UnitX(Factor=length_2)
scale = Scale(Geometry=join_curves, Center=incentre.Incentre, Factor=Slider(0.63, range=0.12..1))  # -> Geometry, Transform
x2 = Multiplication(A=length, B=_2)
rectangle = Rectangle(Plane=PlaneXY(0, 0, 0), XSize=unit_x, YSize=x2, Radius=0)  # -> Rectangle, Length
rectangular_array = RectangularArray(Geometry=scale.Geometry, Cell=rectangle.Rectangle, XCount=Slider(4, range=0..10), YCount=3)  # -> Geometry, Transform

multiplication_2 = Multiplication(A=length, B=number_2)
rectangle_2 = Rectangle(Plane=PlaneXY(0, 0, 0), XSize=multiplication, YSize=multiplication_2, Radius=0)  # -> Rectangle, Length

_2_2 = Number(2)
addition = Addition(A=length)
division = Division(A=number_slider, B=_2_2)
_9 = Number(9)
_2_3 = Number(5)
multiplication_3 = Multiplication(A=division, B=_9)
construct_point = ConstructPoint(XCoordinate=division, YCoordinate=addition, ZCoordinate=0)
multiplication_4 = Multiplication(A=addition, B=_2_3)

number_slider_2 = Slider(1, range=0..10)
linear_array = LinearArray(Geometry=rectangular_array.Geometry, Direction=construct_point, Count=number_slider_2)  # -> Geometry, Transform
move = Move(Geometry=linear_array.Geometry, Motion=construct_point)  # -> Geometry, Transform
linear_array_2 = LinearArray(Geometry=[move.Geometry, rectangular_array.Geometry], Direction=Vector(10, 0, 0), Count=number_slider_2)  # -> Geometry, Transform
custom_preview_2 = CustomPreview(
    Geometry=linear_array_2.Geometry,
    Shader={ambient=RGB(0, 0, 0), diffuse=RGB(255, 105, 180), emission=RGB(76, 32, 54), shine=0.5, specular=RGB(255, 255, 255), transparency=0})

mirror = Mirror(Geometry=linear_array_2.Geometry, Plane=PlaneYZ(0, 0, 0))  # -> Geometry, Transform
number_3 = Number(-3.141592654)
rotate = Rotate(Geometry=mirror.Geometry, Angle=number_3, Plane=PlaneXY(0, 0, 0))  # -> Geometry, Transform
construct_point_2 = ConstructPoint(XCoordinate=multiplication_3, YCoordinate=multiplication_4, ZCoordinate=0)
mirror_2 = Mirror(Geometry=rotate.Geometry, Plane=PlaneYZ(0, 0, 0))  # -> Geometry, Transform
move_2 = Move(Geometry=mirror_2.Geometry, Motion=construct_point_2)  # -> Geometry, Transform
custom_preview_3 = CustomPreview(
    Geometry=move_2.Geometry,
    Shader={ambient=RGB(0, 0, 0), diffuse=RGB(255, 105, 180), emission=RGB(76, 32, 54), shine=0.5, specular=RGB(255, 255, 255), transparency=0})

trim_with_regions = TrimWithRegions(Curve=[linear_array_2.Geometry, move_2.Geometry, triangular.Cells], Regions=rectangle_2.Rectangle)  # -> Inside, Outside
